# Grasshopper definition test.gh (Grasshopper 1.0.7)
# plug-ins: CGALOffsetTool, CGALTools

number_slider = Slider(-62.343, range=-100..100)
crv = Curve(<curve referenced from the Rhino model>)
cgaloffsettool = CGALOffsetTool(Polygon=crv, Distance=<missing>)
offset = OffsetCurve(Curve=crv, Distance=number_slider, Corners=1)
cgaloffset = CGALOffset(Polygon=crv, Distance=number_slider)
